# Grasshopper definition time test.gh (Grasshopper 0.9.76)

# ---- group: 0:16 - 0:45 arm flipped
hours = Slider(6, range=0..12)
minutes = Slider(32, range=28..32)
eval = Evaluate(F="(6*m)-90", m=minutes)
actual_hour_ang = Evaluate(F="0.5*(h *60+m)", h=hours, m=minutes)
eval_2 = Evaluate(F="0.5*(h *60+m)+270-mint_ang", mint_ang=eval, h=hours, m=minutes)
actual_minute_ang = Evaluate(F="(6*m)", m=minutes)
# THE Y ARM NEEDS TO GO IN NEGETIVE SPACE TO AVOID CRASHING
panel = Panel(actual_hour_ang)
panel_2 = Panel(actual_minute_ang)
eval_3 = Evaluate(
    F="(x - in_min) * (out_max - out_min) / (in_max - in_min) + out_min",
    in_min="0",
    in_max="360",
    out_min="-102.2",
    out_max="0",
    x=eval_2)
eval_4 = Evaluate(
    F="(x - in_min) * (out_max - out_min) / (in_max - in_min) + out_min",
    in_min="0",
    in_max="180",
    out_min="55",
    out_max="102.2",
    x=eval)
yy = Panel(eval_3)
xx = Panel(eval_4)

# ---- group: 0:00 - 0:15
hours_2 = Slider(6, range=0..12)
minutes_2 = Slider(33, range=33..59)
number_slider = Slider(0, range=0..100)
eval_5 = Evaluate(F="0.5*(h *60+m)-90", h=hours_2, m=minutes_2)
eval_6 = Evaluate(F="(6*m)-h_ang-90", m=minutes_2, h_ang=eval_5)
eval_7 = Evaluate(
    F="(x - in_min) * (out_max - out_min) / (in_max - in_min) + out_min",
    in_min="0",
    in_max="180",
    out_min="55",
    out_max="102.2",
    x=eval_5)
eval_8 = Evaluate(
    F="(x - in_min) * (out_max - out_min) / (in_max - in_min) + out_min",
    in_min="0",
    in_max="360",
    out_min="-102.2",
    out_max="0",
    x=eval_6)
xx_2 = Panel(eval_7)
yy_2 = Panel(eval_8)

# this is for 5 negetive
hours_3 = Slider(5, range=0..12)
minutes_3 = Slider(27, range=0..27)
number_slider_2 = Slider(0, range=0..100)
eval_9 = Evaluate(F="0.5*(h *60+m)-90", h=hours_3, m=minutes_3)
eval_10 = Evaluate(F="(6*m)-h_ang+270", m=minutes_3, h_ang=eval_9)
eval_11 = Evaluate(
    F="(x - in_min) * (out_max - out_min) / (in_max - in_min) + out_min",
    in_min="0",
    in_max="180",
    out_min="55",
    out_max="102.2",
    x=eval_9)
eval_12 = Evaluate(
    F="(x - in_min) * (out_max - out_min) / (in_max - in_min) + out_min",
    in_min="0",
    in_max="360",
    out_min="-102.2",
    out_max="0",
    x=eval_10)
xx_3 = Panel(eval_11)
yy_3 = Panel(eval_12)

# ----
yy_4 = Slider(1, range=0..1)
xx_4 = Slider(0, range=0..1)
yy_5 = Slider(0, range=0..1)
xx_5 = Slider(0, range=0..1)
check_move = CHECKMOVE(xx=xx_4, x1=xx_3, x2=xx, yy=yy_4, y1=yy_3, y2=yy)  # -> xx_2, yy_2
check_move_2 = CHECKMOVE(xx=xx_5, x1=xx, x2=xx_2, yy=yy_5, y1=yy, y2=yy_2)  # -> xx_2, yy_2

# ---- group: 0:00 - 0:15
hours_4 = Slider(3, range=0..12)
minutes_4 = Slider(42, range=42..60)
number_slider_3 = Slider(0, range=0..100)
eval_13 = Evaluate(F="0.5*(h *60+m)-90", h=hours_4, m=minutes_4)
eval_14 = Evaluate(F="(6*m)-h_ang-90", m=minutes_4, h_ang=eval_13)
eval_15 = Evaluate(
    F="(x - in_min) * (out_max - out_min) / (in_max - in_min) + out_min",
    in_min="0",
    in_max="180",
    out_min="55",
    out_max="102.2",
    x=eval_13)
eval_16 = Evaluate(
    F="(x - in_min) * (out_max - out_min) / (in_max - in_min) + out_min",
    in_min="0",
    in_max="360",
    out_min="-102.2",
    out_max="0",
    x=eval_14)
xx_6 = Panel(eval_15)
yy_6 = Panel(eval_16)

# ---- group: 0:16 - 0:45 arm flipped
hours_5 = Slider(4, range=0..12)
minutes_5 = Slider(36, range=22..36)
eval_17 = Evaluate(F="(6*m)-90", m=minutes_5)
actual_hour_ang_2 = Evaluate(F="0.5*(h *60+m)", h=hours_5, m=minutes_5)
eval_18 = Evaluate(F="0.5*(h *60+m)+270-mint_ang", mint_ang=eval_17, h=hours_5, m=minutes_5)
actual_minute_ang_2 = Evaluate(F="(6*m)", m=minutes_5)
# THE Y ARM NEEDS TO GO IN NEGETIVE SPACE TO AVOID CRASHING
panel_3 = Panel(actual_hour_ang_2)
panel_4 = Panel(actual_minute_ang_2)
eval_19 = Evaluate(
    F="(x - in_min) * (out_max - out_min) / (in_max - in_min) + out_min",
    in_min="0",
    in_max="360",
    out_min="-102.2",
    out_max="0",
    x=eval_18)
eval_20 = Evaluate(
    F="(x - in_min) * (out_max - out_min) / (in_max - in_min) + out_min",
    in_min="0",
    in_max="180",
    out_min="55",
    out_max="102.2",
    x=eval_17)
yy_7 = Panel(eval_19)
xx_7 = Panel(eval_20)

# ---- group: 0:00 - 0:15
# this is for 4 negetive
hours_6 = Slider(4, range=0..12)
minutes_6 = Slider(21, range=0..21)
number_slider_4 = Slider(0, range=0..100)
eval_21 = Evaluate(F="0.5*(h *60+m)-90", h=hours_6, m=minutes_6)
eval_22 = Evaluate(F="(6*m)-h_ang+270", m=minutes_6, h_ang=eval_21)
eval_23 = Evaluate(
    F="(x - in_min) * (out_max - out_min) / (in_max - in_min) + out_min",
    in_min="0",
    in_max="180",
    out_min="55",
    out_max="102.2",
    x=eval_21)
eval_24 = Evaluate(
    F="(x - in_min) * (out_max - out_min) / (in_max - in_min) + out_min",
    in_min="0",
    in_max="360",
    out_min="-102.2",
    out_max="0",
    x=eval_22)
xx_8 = Panel(eval_23)
yy_8 = Panel(eval_24)

# ---- group: 0:16 - 0:45 arm flipped
hours_7 = Slider(6, range=0..12)
minutes_7 = Slider(32, range=28..32)
eval_25 = Evaluate(F="(6*m)-90", m=minutes_7)
actual_hour_ang_3 = Evaluate(F="0.5*(h *60+m)", h=hours_7, m=minutes_7)
eval_26 = Evaluate(F="0.5*(h *60+m)+270-mint_ang", mint_ang=eval_25, h=hours_7, m=minutes_7)
actual_minute_ang_3 = Evaluate(F="(6*m)", m=minutes_7)
# THE Y ARM NEEDS TO GO IN NEGETIVE SPACE TO AVOID CRASHING
panel_5 = Panel(actual_hour_ang_3)
panel_6 = Panel(actual_minute_ang_3)
eval_27 = Evaluate(
    F="(x - in_min) * (out_max - out_min) / (in_max - in_min) + out_min",
    in_min="0",
    in_max="360",
    out_min="-102.2",
    out_max="0",
    x=eval_26)
eval_28 = Evaluate(
    F="(x - in_min) * (out_max - out_min) / (in_max - in_min) + out_min",
    in_min="0",
    in_max="180",
    out_min="55",
    out_max="102.2",
    x=eval_25)
yy_9 = Panel(eval_27)
xx_9 = Panel(eval_28)

# ---- group: 0:00 - 0:15
hours_8 = Slider(4, range=0..12)
minutes_8 = Slider(60, range=37..60)
eval_29 = Evaluate(F="0.5*(h *60+m)-90", h=hours_8, m=minutes_8)
eval_30 = Evaluate(F="(6*m)-h_ang-90", m=minutes_8, h_ang=eval_29)
eval_31 = Evaluate(
    F="(x - in_min) * (out_max - out_min) / (in_max - in_min) + out_min",
    in_min="0",
    in_max="180",
    out_min="55",
    out_max="102.2",
    x=eval_29)
eval_32 = Evaluate(
    F="(x - in_min) * (out_max - out_min) / (in_max - in_min) + out_min",
    in_min="0",
    in_max="360",
    out_min="-102.2",
    out_max="0",
    x=eval_30)
xx_10 = Panel(eval_31)
yy_10 = Panel(eval_32)

hours_9 = Slider(6, range=0..12)
minutes_9 = Slider(34, range=33..59)
eval_33 = Evaluate(F="0.5*(h *60+m)-90", h=hours_9, m=minutes_9)
eval_34 = Evaluate(F="(6*m)-h_ang+270", m=minutes_9, h_ang=eval_33)
eval_35 = Evaluate(
    F="(x - in_min) * (out_max - out_min) / (in_max - in_min) + out_min",
    in_min="0",
    in_max="180",
    out_min="55",
    out_max="102.2",
    x=eval_33)
eval_36 = Evaluate(
    F="(x - in_min) * (out_max - out_min) / (in_max - in_min) + out_min",
    in_min="0",
    in_max="360",
    out_min="-102.2",
    out_max="0",
    x=eval_34)
xx_11 = Panel(eval_35)
yy_11 = Panel(eval_36)

# this is for 6 POSITIVE negetive
hours_10 = Slider(6, range=0..12)
minutes_10 = Slider(27, range=0..27)
number_slider_5 = Slider(0, range=0..100)
eval_37 = Evaluate(F="0.5*(h *60+m)-90", h=hours_10, m=minutes_10)
eval_38 = Evaluate(F="(6*m)-h_ang+270", m=minutes_10, h_ang=eval_37)
eval_39 = Evaluate(
    F="(x - in_min) * (out_max - out_min) / (in_max - in_min) + out_min",
    in_min="0",
    in_max="180",
    out_min="55",
    out_max="102.2",
    x=eval_37)
eval_40 = Evaluate(
    F="(x - in_min) * (out_max - out_min) / (in_max - in_min) + out_min",
    in_min="0",
    in_max="180",
    out_min="0",
    out_max="51.1",
    x=eval_38)
xx_12 = Panel(eval_39)
yy_12 = Panel(eval_40)

# ---- group: 0:16 - 0:45 arm flipped
minutes_11 = Slider(19, range=19..43)
hours_11 = Slider(8, range=0..12)
eval_41 = Evaluate(F="(6*m)-90", m=minutes_11)
actual_hour_ang_4 = Evaluate(F="0.5*(h *60+m)", h=hours_11, m=minutes_11)
eval_42 = Evaluate(F="0.5*(h *60+m)+270-mint_ang", mint_ang=eval_41, h=hours_11, m=minutes_11)
actual_minute_ang_4 = Evaluate(F="(6*m)", m=minutes_11)
# THE Y ARM NEEDS TO GO IN NEGETIVE SPACE TO AVOID CRASHING
panel_7 = Panel(actual_hour_ang_4)
panel_8 = Panel(actual_minute_ang_4)
eval_43 = Evaluate(
    F="(x - in_min) * (out_max - out_min) / (in_max - in_min) + out_min",
    in_min="0",
    in_max="360",
    out_min="-102.2",
    out_max="0",
    x=eval_42)
eval_44 = Evaluate(
    F="(x - in_min) * (out_max - out_min) / (in_max - in_min) + out_min",
    in_min="0",
    in_max="180",
    out_min="55",
    out_max="102.2",
    x=eval_41)
yy_13 = Panel(eval_43)
xx_13 = Panel(eval_44)

hours_12 = Slider(7, range=0..12)
minutes_12 = Slider(27, range=24..38)
eval_45 = Evaluate(F="(6*m)-90", m=minutes_12)
actual_hour_ang_5 = Evaluate(F="0.5*(h *60+m)", h=hours_12, m=minutes_12)
eval_46 = Evaluate(F="0.5*(h *60+m)+270-mint_ang", mint_ang=eval_45, h=hours_12, m=minutes_12)
actual_minute_ang_5 = Evaluate(F="(6*m)", m=minutes_12)
# THE Y ARM NEEDS TO GO IN NEGETIVE SPACE TO AVOID CRASHING
panel_9 = Panel(actual_hour_ang_5)
panel_10 = Panel(actual_minute_ang_5)
eval_47 = Evaluate(
    F="(x - in_min) * (out_max - out_min) / (in_max - in_min) + out_min",
    in_min="0",
    in_max="360",
    out_min="-102.2",
    out_max="0",
    x=eval_46)
eval_48 = Evaluate(
    F="(x - in_min) * (out_max - out_min) / (in_max - in_min) + out_min",
    in_min="0",
    in_max="180",
    out_min="55",
    out_max="102.2",
    x=eval_45)
yy_14 = Panel(eval_47)
# error in mid position after homing
xx_14 = Panel(eval_48)

# ---- group: 0:00 - 0:15
hours_13 = Slider(8, range=0..12)
minutes_13 = Slider(59, range=44..59)
eval_49 = Evaluate(F="0.5*(h *60+m)-90", h=hours_13, m=minutes_13)
eval_50 = Evaluate(F="(6*m)-h_ang+270", m=minutes_13, h_ang=eval_49)
eval_51 = Evaluate(
    F="(x - in_min) * (out_max - out_min) / (in_max - in_min) + out_min",
    in_min="0",
    in_max="180",
    out_min="55",
    out_max="102.2",
    x=eval_49)
eval_52 = Evaluate(
    F="(x - in_min) * (out_max - out_min) / (in_max - in_min) + out_min",
    in_min="0",
    in_max="360",
    out_min="-102.2",
    out_max="0",
    x=eval_50)
xx_15 = Panel(eval_51)
yy_15 = Panel(eval_52)

hours_14 = Slider(7, range=0..12)
minutes_14 = Slider(39, range=39..59)
eval_53 = Evaluate(F="0.5*(h *60+m)-90", h=hours_14, m=minutes_14)
eval_54 = Evaluate(F="(6*m)-h_ang+270", m=minutes_14, h_ang=eval_53)
eval_55 = Evaluate(
    F="(x - in_min) * (out_max - out_min) / (in_max - in_min) + out_min",
    in_min="0",
    in_max="180",
    out_min="55",
    out_max="102.2",
    x=eval_53)
eval_56 = Evaluate(
    F="(x - in_min) * (out_max - out_min) / (in_max - in_min) + out_min",
    in_min="0",
    in_max="360",
    out_min="-102.2",
    out_max="0",
    x=eval_54)
xx_16 = Panel(eval_55)
yy_16 = Panel(eval_56)

# this is for 8 POSITVE QUADRANT
hours_15 = Slider(8, range=0..12)
minutes_15 = Slider(18, range=0..18)
number_slider_6 = Slider(0, range=0..100)
eval_57 = Evaluate(F="0.5*(h *60+m)-90", h=hours_15, m=minutes_15)
eval_58 = Evaluate(F="(6*m)-h_ang+270", m=minutes_15, h_ang=eval_57)
eval_59 = Evaluate(
    F="(x - in_min) * (out_max - out_min) / (in_max - in_min) + out_min",
    in_min="0",
    in_max="180",
    out_min="55",
    out_max="102.2",
    x=eval_57)
eval_60 = Evaluate(
    F="(x - in_min) * (out_max - out_min) / (in_max - in_min) + out_min",
    in_min="0",
    in_max="360",
    out_min="0",
    out_max="102.2",
    x=eval_58)
xx_17 = Panel(eval_59)
yy_17 = Panel(eval_60)

# this is for 7 POSITIVE negetive
hours_16 = Slider(7, range=0..12)
minutes_16 = Slider(23, range=0..23)
number_slider_7 = Slider(0, range=0..100)
eval_61 = Evaluate(F="0.5*(h *60+m)-90", h=hours_16, m=minutes_16)
eval_62 = Evaluate(F="(6*m)-h_ang+270", m=minutes_16, h_ang=eval_61)
eval_63 = Evaluate(
    F="(x - in_min) * (out_max - out_min) / (in_max - in_min) + out_min",
    in_min="0",
    in_max="180",
    out_min="55",
    out_max="102.2",
    x=eval_61)
eval_64 = Evaluate(
    F="(x - in_min) * (out_max - out_min) / (in_max - in_min) + out_min",
    in_min="0",
    in_max="180",
    out_min="0",
    out_max="51.1",
    x=eval_62)
xx_18 = Panel(eval_63)
yy_18 = Panel(eval_64)

# ---- group: 0:16 - 0:45 arm flipped
minutes_17 = Slider(41, range=17..41)
hours_17 = Slider(3, range=0..12)
eval_65 = Evaluate(F="(6*m)-90", m=minutes_17)
eval_66 = Evaluate(F="0.5*(h *60+m)+270-mint_ang", mint_ang=eval_65, h=hours_17, m=minutes_17)
eval_67 = Evaluate(
    F="(x - in_min) * (out_max - out_min) / (in_max - in_min) + out_min",
    in_min="0",
    in_max="360",
    out_min="-102.2",
    out_max="0",
    x=eval_66)
eval_68 = Evaluate(
    F="(x - in_min) * (out_max - out_min) / (in_max - in_min) + out_min",
    in_min="0",
    in_max="180",
    out_min="55",
    out_max="102.2",
    x=eval_65)
yy_19 = Panel(eval_67)
xx_19 = Panel(eval_68)

# ----
# problem in transition from 2 to 3
# NEEDS TO HOME
panel_11 = Panel("0.5*(h *60+m)-90")

# ---- group: 0:00 - 0:15
# this is for 3 NEGETIVE
hours_18 = Slider(3, range=0..12)
minutes_18 = Slider(16, range=0..16)
number_slider_8 = Slider(0, range=0..100)
eval_69 = Evaluate(F=panel_11, h=hours_18, m=minutes_18)
eval_70 = Evaluate(F="(6*m)-h_ang+270", m=minutes_18, h_ang=eval_69)
# THE Y ARM NEEDS TO GO IN NEGETIVE SPACE TO AVOID CRASHING
panel_12 = Panel("0")
eval_71 = Evaluate(
    F="(x - in_min) * (out_max - out_min) / (in_max - in_min) + out_min",
    in_min="0",
    in_max="180",
    out_min="55",
    out_max="102.2",
    x=eval_69)
eval_72 = Evaluate(
    F="(x - in_min) * (out_max - out_min) / (in_max - in_min) + out_min",
    in_min="0",
    in_max="360",
    out_min="-102.2",
    out_max=panel_12,
    x=eval_70)
xx_20 = Panel(eval_71)
yy_20 = Panel(eval_72)

# ----
# TRANSITION FROM 45 TO 45
#  NEED THE Y TO GO TO 55
# TRANSITION FROM 45 TO 45
#  NEED THE Y TO GO TO 0
number_slider_9 = Slider(0, range=0..1)
number_slider_10 = Slider(0, range=0..101.6)
xx_21 = Slider(1, range=0..1)
yy_21 = Slider(0, range=0..1)
number_slider_11 = Slider(78.5, range=0..100)
number_slider_12 = Slider(0, range=0..100)
xx_22 = Slider(1, range=0..1)
yy_22 = Slider(1, range=0..1)
xx_23 = Slider(0, range=0..1)
yy_23 = Slider(0, range=0..1)
yy_24 = Slider(1, range=0..1)
yy_25 = Slider(0, range=0..1)
yy_26 = Slider(0, range=0..1)
yy_27 = Slider(1, range=0..1)
number_slider_13 = Slider(-78, range=-78..25)
number_slider_14 = Slider(0, range=0..100)
# error in mid position after homing
xx_24 = Slider(1, range=0..1)
yy_28 = Slider(1, range=0..1)
xx_25 = Slider(1, range=0..1)
yy_29 = Slider(1, range=0..1)
xx_26 = Slider(0, range=0..1)
xx_27 = Slider(1, range=0..1)
number_slider_15 = Slider(78.5, range=0..100)
yy_30 = Slider(0.024, range=0..1)
yy_31 = Slider(0, range=0..1)
number_slider_16 = Slider(102.2, range=102.2..212.12)
xx_28 = Slider(1, range=0..1)
xx_29 = Slider(0, range=0..1)
xx_30 = Slider(1, range=0..1)
dom = ConstructDomain(DomainStart=Slider(78.5, range=0..100), DomainEnd=xx_20)
dom_2 = ConstructDomain(DomainStart=0, DomainEnd=1)
dom_3 = ConstructDomain(DomainStart=0, DomainEnd=1)
xx_31 = Slider(1, range=0..1)
dom_4 = ConstructDomain(DomainStart=Slider(0, range=0..100), DomainEnd=yy_20)
panel_13 = Panel("""243.54,-8.52

243.67,-6.96
243.80,-5.39
243.93,-3.83
244.06,-2.27
244.19,-0.71
244.33,0.85
244.46,2.41
244.59,3.97
244.72,5.54
244.85,7.10
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""")
remap = RemapNumbers(Value=Slider(1, range=0..1), Source=dom_3, Target=dom)  # -> Mapped, Clipped
check_move_3 = CHECKMOVE(xx=xx_21, x1=xx_19, x2=xx_6, yy=yy_21, y1=yy_19, y2=yy_6)  # -> xx_2, yy_2
remap_2 = RemapNumbers(Value=Slider(1, range=0..1), Source=dom_2, Target=dom_4)  # -> Mapped, Clipped
check_move_4 = CHECKMOVE(xx=xx_22, x1=number_slider_11, x2=xx_13, yy=yy_22, y1=number_slider_12, y2=yy_13)  # -> xx_2, yy_2
check_move_5 = CHECKMOVE(xx=xx_23, x1=number_slider_11, x2=xx_17, yy=yy_23, y1=number_slider_12, y2=yy_17)  # -> xx_2, yy_2
check_move_6 = CHECKMOVE(xx=xx_25, x1=xx_12, x2=xx_9, yy=yy_27, y1=yy_12, y2=yy_9)  # -> xx_2, yy_2
check_move_7 = CHECKMOVE(xx=xx_26, x1=xx_9, x2=xx_11, yy=yy_25, y1=yy_9, y2=yy_11)  # -> xx_2, yy_2
check_move_8 = CHECKMOVE(xx=xx_27, x1=Slider(78.5, range=0..100), x2=xx_12, yy=yy_24, y1=Slider(0, range=0..100), y2=yy_12)  # -> xx_2, yy_2
check_move_9 = CHECKMOVE(xx=xx_24, x1=Slider(78.5, range=0..100), x2=xx_15, yy=yy_28, y1=Slider(0, range=0..100), y2=yy_15)  # -> xx_2, yy_2
panel_14 = Panel(check_move.yy_2)
panel_15 = Panel(dom_4)
check_move_10 = CHECKMOVE(xx=xx_28, x1=number_slider_15, x2=xx_14, yy=yy_29, y1=number_slider_14, y2=yy_14)  # -> xx_2, yy_2
check_move_11 = CHECKMOVE(xx=xx_29, x1=xx_14, x2=xx_16, yy=yy_31, y1=yy_14, y2=yy_16)  # -> xx_2, yy_2
panel_16 = Panel(remap_2.Mapped)
check_move_12 = CHECKMOVE(xx=xx_30, x1=number_slider_15, x2=xx_18, yy=yy_30, y1=number_slider_14, y2=yy_18)  # -> xx_2, yy_2

# ---- group: 0:16 - 0:45 arm flipped
hours_19 = Slider(9, range=0..14)
minutes_19 = Slider(15, range=15..45)
eval_73 = Evaluate(F="(6*m)-90", m=minutes_19)
actual_hour_ang_6 = Evaluate(F="0.5*(h *60+m)", h=hours_19, m=minutes_19)
eval_74 = Evaluate(F="0.5*(h *60+m)+270-mint_ang", mint_ang=eval_73, h=hours_19, m=minutes_19)
actual_minute_ang_6 = Evaluate(F="(6*m)", m=minutes_19)
# THE Y ARM NEEDS TO GO IN NEGETIVE SPACE TO AVOID CRASHING
panel_17 = Panel(actual_hour_ang_6)
panel_18 = Panel(actual_minute_ang_6)
eval_75 = Evaluate(
    F="(x - in_min) * (out_max - out_min) / (in_max - in_min) + out_min",
    in_min="0",
    in_max="360",
    out_min="-102.2",
    out_max="0",
    x=eval_74)
eval_76 = Evaluate(
    F="(x - in_min) * (out_max - out_min) / (in_max - in_min) + out_min",
    in_min="0",
    in_max="180",
    out_min="55",
    out_max="102.2",
    x=eval_73)
yy_32 = Panel(eval_75)
xx_32 = Panel(eval_76)

# ---- group: 0:00 - 0:15
# this is for 9 -14
hours_20 = Slider(9, range=0..14)
minutes_20 = Slider(14, range=0..15)
number_slider_17 = Slider(0, range=0..100)
eval_77 = Evaluate(F="0.5*(h *60+m)-270", h=hours_20, m=minutes_20)
eval_78 = Evaluate(F="(6*m)-h_ang+90", m=minutes_20, h_ang=eval_77)
eval_79 = Evaluate(
    F="(x - in_min) * (out_max - out_min) / (in_max - in_min) + out_min",
    in_min="0",
    in_max="180",
    out_min="212.12",
    out_max="259.25",
    x=eval_77)
eval_80 = Evaluate(
    F="(x - in_min) * (out_max - out_min) / (in_max - in_min) + out_min",
    in_min="0",
    in_max="180",
    out_min="0",
    out_max="51.1",
    x=eval_78)
xx_33 = Panel(eval_79)
yy_33 = Panel(eval_80)

hours_21 = Slider(13, range=0..14)
minutes_21 = Slider(45, range=45..60)
number_slider_18 = Slider(0, range=0..100)
eval_81 = Evaluate(F="0.5*(h *60+m)-270", h=hours_21, m=minutes_21)
eval_82 = Evaluate(F="(6*m)-h_ang+90", m=minutes_21, h_ang=eval_81)
eval_83 = Evaluate(
    F="(x - in_min) * (out_max - out_min) / (in_max - in_min) + out_min",
    in_min="0",
    in_max="180",
    out_min="212.12",
    out_max="259.25",
    x=eval_81)
eval_84 = Evaluate(
    F="(x - in_min) * (out_max - out_min) / (in_max - in_min) + out_min",
    in_min="0",
    in_max="360",
    out_min="-102.2",
    out_max="0",
    x=eval_82)
xx_34 = Panel(eval_83)
yy_34 = Panel(eval_84)

# ----
check_move_13 = CHECKMOVE(xx=xx_31, x1=Slider(78.5, range=0..100), x2=xx_19, yy=yy_26, y1=Slider(0, range=0..100), y2=yy_19)  # -> xx_2, yy_2
panel_19 = Panel("""86.47,42.58

86.60,44.14
86.73,45.71
86.86,47.27
86.99,48.83
87.12,50.39
87.25,51.95
87.38,53.51
87.52,55.07
87.65,56.64
87.78,58.20
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""")
xx_35 = Number(check_move_13.xx_2)
number_slider_19 = Slider(22, range=0..239)
yy_35 = Number(check_move_13.yy_2)
_9_12 = Panel("""212.12,25.55

212.25,27.11
212.38,28.67
212.51,30.23
212.64,31.80
212.77,33.36
212.91,34.92
213.04,36.48
213.17,38.04
213.30,39.60
213.43,41.16
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
220.11,18.59
220.24,20.16
220.37,21.72
220.50,23.28
220.63,24.84
220.76,26.40
220.89,27.96
221.02,29.52
221.15,31.09
221.28,32.65
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
227.96,10.08
228.09,11.64
228.22,13.20
228.35,14.76
228.48,16.32
228.62,17.88
228.75,19.45
228.88,21.01
229.01,22.57
229.14,24.13
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
235.82,1.56
235.95,3.12
236.08,4.68
236.21,6.25
236.34,7.81
236.47,9.37
236.60,10.93
236.73,12.49
236.86,14.05
236.99,15.61
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""")
panel_20 = Panel("""70.73,-42.58

70.86,-41.02
71.00,-39.46
71.13,-37.90
71.26,-36.34
71.39,-34.78
71.52,-33.21
71.65,-31.65
71.78,-30.09
71.91,-28.53
72.04,-26.97
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""")
pdecon = Deconstruct(Point=panel_19)  # -> XComponent, YComponent, ZComponent
item = ListItem(List=pdecon.XComponent, Index=number_slider_19, Wrap=True)
item_2 = ListItem(List=pdecon.YComponent, Index=number_slider_19, Wrap=True)
xx_36 = Slider(1, range=0..1)
yy_36 = Slider(1, range=0..1)
number_slider_20 = Slider(0, range=0..100)
number_slider_21 = Slider(78.5, range=0..100)
number_slider_22 = Slider(0, range=0..100)
panel_21 = Panel("""243.54,-8.52
243.67,-6.96
243.80,-5.39
243.93,-3.83
244.06,-2.27
244.19,-0.71
244.33,0.85
244.46,2.41
244.59,3.97
244.72,5.54
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""")
dom_5 = ConstructDomain(DomainStart=xx_32, DomainEnd=xx_34)
dom_6 = ConstructDomain(DomainStart=0, DomainEnd=1)
dom_7 = ConstructDomain(DomainStart=yy_32, DomainEnd=yy_34)
dom_8 = ConstructDomain(DomainStart=0, DomainEnd=1)
number_slider_23 = Slider(44, range=0..239)
remap_3 = RemapNumbers(Value=Slider(0, range=0..1), Source=dom_6, Target=dom_5)  # -> Mapped, Clipped
remap_4 = RemapNumbers(Value=Slider(0.083, range=0..1), Source=dom_8, Target=dom_7)  # -> Mapped, Clipped
check_move_14 = CHECKMOVE(xx=xx_36, x1=xx_33, x2=xx_32, yy=yy_36, y1=yy_33, y2=yy_32)  # -> xx_2, yy_2
pdecon_2 = Deconstruct(Point=panel_21)  # -> XComponent, YComponent, ZComponent
item_3 = ListItem(List=pdecon_2.XComponent, Index=number_slider_23, Wrap=True)
item_4 = ListItem(List=pdecon_2.YComponent, Index=number_slider_23, Wrap=True)
panel_22 = Panel("""900,55,25.55
901,55.131111,27.253333
902,55.262222,28.956667
903,55.393333,30.66
904,55.524444,32.363333
905,55.655556,34.066667
906,55.786667,35.77
907,55.917778,37.473333
908,56.048889,39.176667
909,56.18,40.88
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""")
# arduino formulas: float hour_angle = (0.5 * (hh*60 + mm))-270 ;
#     float minute_angle = 6*mm -90- hour_angle;
#     float map_hh = mapf(hour_angle,0,180,55,102.12);
#     float map_mm = mapf(minute_angle,0,180,0,55.12);
panel_23 = Panel("0")
# map function: float mapf(float x, float in_min, float in_max, float out_min, float out_max)
# {
#   return (x - in_min) * (out_max - out_min) / (in_max - in_min) + out_min;
# }
number_slider_24 = Slider(15, range=0..100)
series = Series(Start=panel_23, Step=1, Count=Slider(60, range=0..100))
split = TextSplit(Text=panel_22, Separators=",")
int = Integer(series)
x = Panel("""55
55.131111
55.262222
55.393333
55.524444
55.655556
55.786667
55.917778
56.048889
56.18
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""")
bottom_led = Panel("""0
0
0
0
0
0
0
0
0
0
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""")
y = Panel("""25.55
27.253333
28.956667
30.66
32.363333
34.066667
35.77
37.473333
39.176667
40.88
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""")
home = Panel("""0
0
0
0
0
0
0
0
0
0
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""")
top_led = Panel("""1
1
1
1
1
1
1
1
1
1
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""")
series_2 = Series(Start=Slider(0, range=0..100), Step=1, Count=number_slider_24)
flip = FlipMatrix(Data=split)
panel_24 = Panel(flip)
panel_25 = Panel(int)
multiplication = Multiplication(A=series_2, B="6")
dom_9 = ConstructDomain(DomainStart=0, DomainEnd="360")
dom_10 = ConstructDomain(DomainStart="0", DomainEnd="102.2")
addition = Addition(A=multiplication, B=90)
remap_5 = RemapNumbers(Value=addition, Source=dom_9, Target=dom_10)  # -> Mapped, Clipped
panel_26 = Panel(addition)

# ---- group: remap bottom arm values
# on shift zero in center... first fulcrum will be :
# 110/2 + 3.14*17/2
# 
# 81.69
number_slider_25 = Slider(0, range=0..180)
dom_11 = ConstructDomain(DomainStart=0, DomainEnd="180")
dom_12 = ConstructDomain(DomainStart="212.12", DomainEnd="259.24")
dom_13 = ConstructDomain(DomainStart=0, DomainEnd="180")
dom_14 = ConstructDomain(DomainStart="55", DomainEnd="102.2")
top_rotate = RemapNumbers(Value=number_slider_25, Source=dom_11, Target=dom_12)  # -> Mapped, Clipped
bottom_rotate = RemapNumbers(Value=Slider(0, range=0..180), Source=dom_13, Target=dom_14)  # -> Mapped, Clipped

# ----
format = Format(
    Format="{{{0},{1},{2},{3},{4},{5}}},",
    Culture=127,
    Data0=panel_25,
    Data1=x,
    Data2=y,
    Data3=home,
    Data4=bottom_led,
    Data5=top_led)

# ---- group: curve generation
point_distance = Slider(110, range=0..1000)
pt = ConstructPoint(XCoordinate=0, YCoordinate=0, ZCoordinate=0)
pt_2 = Point(pt)
dom_15 = ConstructDomain(DomainStart="0", DomainEnd="-90")
rad = Radians(Degrees=dom_15)
arc = Arc(Plane=pt_2, Radius=Slider(15, range=0..100), Angle=rad)  # -> Arc, Length
rad_2 = Radians(Degrees="-90")
rad_3 = Radians(Degrees="90")
rad_4 = Radians(Degrees="180")
rotate = Rotate(Geometry=arc.Arc, Angle=rad_2, Plane=pt_2)  # -> Geometry, Transform
rotate_2 = Rotate(Geometry=arc.Arc, Angle=rad_3, Plane=pt_2)  # -> Geometry, Transform
rotate_3 = Rotate(Geometry=arc.Arc, Angle=rad_4, Plane=pt_2)  # -> Geometry, Transform
join = JoinCurves(Curves=[rotate.Geometry, rotate_3.Geometry], Preserve=False)
join_2 = JoinCurves(Curves=[arc.Arc, rotate_2.Geometry], Preserve=False)
division = Division(A=point_distance, B=Slider(2, range=0..10))
end = EndPoints(Curve=join)  # -> Start, End
X = UnitX(Factor=point_distance)
move = Move(Geometry=join_2, Motion=X)  # -> Geometry, Transform
X_2 = UnitX(Factor=division)
X_3 = UnitX(Factor=division)
end_2 = EndPoints(Curve=move.Geometry)  # -> Start, End
explode = Explode(Curve=move.Geometry, Recursive=True)  # -> Segments, Vertices
explode_2 = Explode(Curve=join, Recursive=True)  # -> Segments, Vertices
move_2 = Move(Geometry=end.Start, Motion=X_2)  # -> Geometry, Transform
move_3 = Move(Geometry=end_2.Start, Motion=expr("-x", X_3))  # -> Geometry, Transform
ln = Line(StartPoint=end_2.Start, EndPoint=move_3.Geometry)
ln_2 = Line(StartPoint=end.End, EndPoint=move_3.Geometry)
item_5 = ListItem(List=explode.Segments, Index=0, Wrap=True)
item_6 = ListItem(List=explode_2.Segments, Index=1, Wrap=True)
item_7 = ListItem(List=explode_2.Segments, Index=0, Wrap=True)
ln_3 = Line(StartPoint=end.Start, EndPoint=move_2.Geometry)
item_8 = ListItem(List=explode.Segments, Index=1, Wrap=True)
ln_4 = Line(StartPoint=move_2.Geometry, EndPoint=end_2.End)
trim = TrimTree(Tree=item_8, Depth=1)
trim_2 = TrimTree(Tree=item_5, Depth=1)
trim_3 = TrimTree(Tree=item_6, Depth=1)
trim_4 = TrimTree(Tree=item_7, Depth=1)
join_3 = JoinCurves(Curves=[ln_4, trim, trim_2, ln, ln_2, trim_3, trim_4, ln_3], Preserve=False)
explode_3 = Explode(Curve=join_3, Recursive=True)  # -> Segments, Vertices
item_9 = ListItem(List=explode_3.Segments, Index=Slider(0, range=0..10), Wrap=True)
shift = ShiftList(List=explode_3.Segments, Shift=1, Wrap=True)
join_4 = JoinCurves(Curves=shift, Preserve=False)

# ----
panel_27 = Panel(remap_5.Mapped)
upper_fulcrum = Slider(259.24, range=212.12..259.24)
format_2 = Format(Culture=127)
lower_fulcrum = Slider(78.6, range=55..102.12)
panel_28 = Panel(format)
bottom_arm_position = Number(xx_35)
number_slider_26 = Slider(55, range=0..314.2)
number_slider_27 = Slider(-11, range=-102..0)
rotation_distance_y = Slider(12.2, range=-102..102)
# clock angles: int hour_angle = 0.5 * (h*60 + m);
#     int minute_angle = 6*m;
# 
# angle between hour and minute :
# hour angle - minute
# if > 180 then 360 - the result
# 
# always subtract value by 360 and then use the minimum value
hours_22 = Slider(9, range=0..12)
minutes_22 = Slider(15, range=0..60)
number_slider_28 = Slider(0, range=0..1000)
dom_16 = ConstructDomain(DomainStart="0", DomainEnd="360")
dom_17 = ConstructDomain(DomainStart="0", DomainEnd="102.2")
rotation_value = Number(yy_35)
multiplication_2 = Multiplication(A=minutes_22, B="6")
remap_6 = RemapNumbers(Value=rotation_value, Source=dom_17, Target=dom_16)  # -> Mapped, Clipped
time = Integer([hours_22, minutes_22])
eval_85 = Evaluate(F="0.5*(h *60+m)", h=hours_22, m=minutes_22)
rad_5 = Radians(Degrees="90")
Y = UnitY(Factor=Slider(50, range=0..100))
number_slider_29 = Slider(14, range=0..14)
pt_3 = ConstructPoint(XCoordinate=x, YCoordinate=y, ZCoordinate=0)
item_10 = ListItem(List=pt_3, Index=Slider(0, range=0..60), Wrap=True)
pdecon_3 = Deconstruct(Point=item_10)  # -> XComponent, YComponent, ZComponent
panel_29 = Panel(pdecon_3.YComponent)
panel_30 = Panel(pdecon_3.XComponent)
true_rotation_angle = Number(remap_6.Mapped)
dom_18 = ConstructDomain(DomainStart="-51", DomainEnd="51")
dom_19 = ConstructDomain(DomainStart="-180", DomainEnd="180")
remap_7 = RemapNumbers(Value=rotation_value, Source=dom_18, Target=dom_19)  # -> Mapped, Clipped
rotation = Number(true_rotation_angle)
rad_6 = Radians(Degrees=rotation)
yz = YZPlane(Origin=Point(0, 0, 0))
mirror = Mirror(Geometry=join_4, Plane=yz)  # -> Geometry, Transform
crv = Curve(mirror.Geometry)
crv_2 = Curve(crv)
crv_3 = Curve(crv_2)
eval_86 = EvaluateLength(Curve=crv_3, Length=bottom_arm_position, Normalized=False)  # -> Point, Tangent, Parameter
xy = XYPlane(Origin=eval_86.Point)
panel_31 = Panel(crv_3)
explode_4 = Explode(Curve=crv_3, Recursive=True)  # -> Segments, Vertices
line = LineSDL(Start=eval_86.Point, Direction=eval_86.Tangent, Length="100")
rotate_4 = Rotate(Geometry=line, Angle=rad_5, Plane=xy)  # -> Geometry, Transform
item_11 = ListItem(List=explode_4.Segments, Index="5", Wrap=True)
item_12 = ListItem(List=explode_4.Segments, Index="6", Wrap=True)
end_3 = EndPoints(Curve=rotate_4.Geometry)  # -> Start, End
end_4 = EndPoints(Curve=line)  # -> Start, End
join_5 = JoinCurves(Curves=[item_11, item_12], Preserve=False)
end_5 = EndPoints(Curve=join_5)  # -> Start, End
pl_3pt = Plane3Pt(PointA=eval_86.Point, PointB=end_4.End, PointC=end_3.End)
ln_5 = Line(StartPoint=end_5.Start, EndPoint=end_5.End)
orient = Orient(Geometry=crv_3, Source=pl_3pt, Target=PlaneXY(0, 0, 0))  # -> Geometry, Transform
offset = Offset(Curve=orient.Geometry, Distance="-3", Plane=PlaneXY(0, 0, 0), Corners=1)
eval_87 = EvaluateLength(Curve=ln_5, Length="0.5", Normalized=True)  # -> Point, Tangent, Parameter
eval_88 = EvaluateLength(Curve=join_5, Length="0.5", Normalized=True)  # -> Point, Tangent, Parameter
explode_5 = Explode(Curve=orient.Geometry, Recursive=True)  # -> Segments, Vertices
pl_3pt_2 = Plane3Pt(PointA=eval_87.Point, PointB=end_5.End, PointC=eval_88.Point)
preview = CustomPreview(Geometry=[offset, orient.Geometry], Shader=ColourSwatch(SwatchColor=RGB(207, 14, 14)))
item_13 = ListItem(List=explode_5.Segments, Index="5", Wrap=True)
item_14 = ListItem(List=explode_5.Segments, Index="6", Wrap=True)
panel_32 = Panel(pl_3pt_2)
join_6 = JoinCurves(Curves=[item_13, item_14], Preserve=False)
end_6 = EndPoints(Curve=join_6)  # -> Start, End
ln_6 = Line(StartPoint=end_6.Start, EndPoint=end_6.End)
eval_89 = EvaluateLength(Curve=ln_6, Length="0.5", Normalized=True)  # -> Point, Tangent, Parameter
eval_90 = EvaluateLength(Curve=item_13, Length="0.5", Normalized=True)  # -> Point, Tangent, Parameter
pl_3pt_3 = Plane3Pt(PointA=eval_89.Point, PointB=end_6.End, PointC=eval_90.Point)
panel_33 = Panel(ln_6)
orient_2 = Orient(Geometry=crv_3, Source=pl_3pt_2, Target=pl_3pt_3)  # -> Geometry, Transform
cir = Circle(Plane=pl_3pt_3, Radius="15")
rotate_5 = Rotate(Geometry=orient_2.Geometry, Angle=rad_6, Plane=pl_3pt_3)  # -> Geometry, Transform
explode_6 = Explode(Curve=rotate_5.Geometry, Recursive=True)  # -> Segments, Vertices
item_15 = ListItem(List=explode_6.Segments, Index="1", Wrap=True)
item_16 = ListItem(List=explode_6.Segments, Index="2", Wrap=True)
join_7 = JoinCurves(Curves=[item_15, item_16], Preserve=False)
end_7 = EndPoints(Curve=join_7)  # -> Start, End
ln_7 = Line(StartPoint=end_7.Start, EndPoint=end_7.End)
eval_91 = EvaluateLength(Curve=ln_7, Length="0.5", Normalized=True)  # -> Point, Tangent, Parameter
eval_92 = EvaluateLength(Curve=item_15, Length="0.5", Normalized=True)  # -> Point, Tangent, Parameter
pl_3pt_4 = Plane3Pt(PointA=eval_91.Point, PointB=end_7.End, PointC=eval_92.Point)
cir_2 = Circle(Plane=pl_3pt_4, Radius="15")
offset_2 = Offset(Curve=cir, Distance="2", Plane=PlaneXY(0, 0, 0), Corners=1)
offset_3 = Offset(Curve=cir_2, Distance="2", Plane=PlaneXY(0, 0, 0), Corners=1)
offset_4 = Offset(Curve=rotate_5.Geometry, Distance="-2", Plane=PlaneXY(0, 0, 0), Corners=1)
panel_34 = Panel(orient_2.Geometry)
preview_2 = CustomPreview(
    Geometry=[offset_4, rotate_5.Geometry, offset_2, cir, offset_3, cir_2],
    Shader=ColourSwatch(SwatchColor=RGB(255, 255, 255)))

# ==== cluster CHECKMOVE
y1 = ClusterInput()
y2 = ClusterInput()
x1 = ClusterInput()
x2 = ClusterInput()
dom = ConstructDomain(DomainStart=y1, DomainEnd=y2)
dom_2 = ConstructDomain(DomainStart=x1, DomainEnd=x2)
xx = ClusterInput()
dom_3 = ConstructDomain(DomainStart=0, DomainEnd=1)
yy = ClusterInput()
dom_4 = ConstructDomain(DomainStart=0, DomainEnd=1)
remap = RemapNumbers(Value=xx, Source=dom_3, Target=dom_2)  # -> Mapped, Clipped
remap_2 = RemapNumbers(Value=yy, Source=dom_4, Target=dom)  # -> Mapped, Clipped
xx_2 = ClusterOutput(remap.Mapped)
yy_2 = ClusterOutput(remap_2.Mapped)
